vi "index.gviweb"   [G Web Development Software 22.0.0]
panel controls:
  "Login Link": string = "/login.html"
  "Register Link": string = "/register.html"
  "Logout Link": string = "/logout"
uses:
  WebApp::Support::Auth::GET User Info.gvi
diagram:
  s1 = "Init"  # shift register
  while {
    case (s1) {
      frame "Init" {
        Property Node(instance in=reference to "Login Link", "Visible"=FALSE)
        Property Node(instance in=reference to "Register Link", "Visible"=FALSE)
        Property Node(instance in=reference to "Logout Link", "Visible"=FALSE)
        w1 = "Ready"
      }
      frame "Ready" {
        call "GET User Info.gvi"() -> (User Info=w2, Logged In=w3)
        case (w3) {
          frame False, Default { }
          frame True {
            Property Node(instance in=w2) -> ("first_name"=w4)
            Format Into String(formatString="Welcome, %s!", w4) -> w5
            Property Node(instance in=reference to unnamed text, "Text"=w5)
          }
        }
        Not(x=w3) -> w6
        Property Node(instance in=reference to "Login Link", "Visible"=w6)
        Property Node(instance in=reference to "Register Link", "Visible"=w6)
        Property Node(instance in=reference to "Logout Link", "Visible"=w3)
        w1 = "Run"
      }
      frame "Run" {
        Wait(time to wait=100)
        w1 = "Run"
      }
    }
    next s1 = w1
    stop if FALSE
  }
